# Grasshopper definition simulations.gh (Grasshopper 1.0.7)
# plug-ins: CORE.Grasshopper.Colibri, Human, Ambrosinus Toolkit

cp = Slider(11, range=1..11)

# ----
# Fractional Factorial Design
# Connect for IOH & sDA!
# Connect all x's!
# Connect IP!
simulations = Slider(64, range=1..64)
panel = Panel("G:\Mi unidad\Post-Doc DATAI\Investigación\Computational Design/_FractionalFactorialDesign/fractional_design.csv")
colibri_in = ColibriInputsIterator(Simulations=simulations, ignoreAllWarningMsg=True)  # -> U, IP, Simulations, V_N
file = ReadFile(File=panel, PerLineParse=True)
panel_2 = Panel(colibri_in.U)
panel_3 = Panel(file)
compass = LBCompass(scale="0.1")  # -> compass; plug-in component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
item = ListItem(List=file, Index=colibri_in.Simulations, Wrap=True)
flatten = FlattenTree(Tree=item, Path="{0}")
python = GhPythonScript(x=flatten)  # -> out, WWR_N, WWR_S, WWR_E, WWR_W, RoofOvrhng_N, RoofOvrhng_S, RoofOvrhng_E, RoofOvrhng_W
# ---------- python: Python ----------
__author__ = "jgamero"
__version__ = "2024.04.10"

import rhinoscriptsyntax as rs

WWR_N = x[-30]
WWR_S = x[-26]
WWR_E = x[-22]
WWR_W = x[-18]
RoofOvrhng_N = x[-14]
RoofOvrhng_S = x[-10]
RoofOvrhng_E = x[-6]
RoofOvrhng_W = x[-2]


# Replace with original values


## Window-to-wall ratio @ North
WWR_N = list(WWR_N)

for i in range(len(WWR_N)):
    if WWR_N[i] == "1":
        WWR_N[i] = "0.4"

for i in range(len(WWR_N)):
    if WWR_N[i] == "0":
        WWR_N[i] = "0.05"


## Window-to-wall ratio @ South
WWR_S = list(WWR_S)

for i in range(len(WWR_S)):
    if WWR_S[i] == "1":
        WWR_S[i] = "0.4"

for i in range(len(WWR_S)):
    if WWR_S[i] == "0":
        WWR_S[i] = "0.05"


## Window-to-wall ratio @ East
WWR_E = list(WWR_E)

for i in range(len(WWR_E)):
    if WWR_E[i] == "1":
        WWR_E[i] = "0.4"

for i in range(len(WWR_E)):
    if WWR_E[i] == "0":
        WWR_E[i] = "0.05"


## Window-to-wall ratio @ East
WWR_W = list(WWR_W)

for i in range(len(WWR_W)):
    if WWR_W[i] == "1":
        WWR_W[i] = "0.4"

for i in range(len(WWR_W)):
    if WWR_W[i] == "0":
        WWR_W[i] = "0.05"


## Roof Overhang @ North
RoofOvrhng_N = list(RoofOvrhng_N)

for i in range(len(RoofOvrhng_N)):
    if RoofOvrhng_N[i] == "1":
        RoofOvrhng_N[i] = "2.5"

for i in range(len(RoofOvrhng_N)):
    if RoofOvrhng_N[i] == "0":
        RoofOvrhng_N[i] = "0.5"


## Roof Overhang @ South
RoofOvrhng_S = list(RoofOvrhng_S)

for i in range(len(RoofOvrhng_S)):
    if RoofOvrhng_S[i] == "1":
        RoofOvrhng_S[i] = "2.5"

for i in range(len(RoofOvrhng_S)):
    if RoofOvrhng_S[i] == "0":
        RoofOvrhng_S[i] = "0.5"


## Roof Overhang @ East
RoofOvrhng_E = list(RoofOvrhng_E)

for i in range(len(RoofOvrhng_E)):
    if RoofOvrhng_E[i] == "1":
        RoofOvrhng_E[i] = "2.5"

for i in range(len(RoofOvrhng_E)):
    if RoofOvrhng_E[i] == "0":
        RoofOvrhng_E[i] = "0.5"


## Roof Overhang @ West
RoofOvrhng_W = list(RoofOvrhng_W)

for i in range(len(RoofOvrhng_W)):
    if RoofOvrhng_W[i] == "1":
        RoofOvrhng_W[i] = "2.5"

for i in range(len(RoofOvrhng_W)):
    if RoofOvrhng_W[i] == "0":
        RoofOvrhng_W[i] = "0.5"
# ---------- end python ----------
panel_4 = Panel(flatten)

compass_2 = LBCompass(scale="0.1")  # -> compass; plug-in component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
# Roof parameters:
# - U value
# - Thermal mass (k)
panel_5 = Panel("2")
# Wall parameters:
# - U value
# - Thermal mass (k)
panel_6 = Panel("10")
panel_7 = Panel("G:\Mi unidad\Post-Doc DATAI\Investigación\Computational Design\_FractionalFactorialDesign\_results\_ViewCapture")
get_number = GetNumber(panel_5, AtLeast=1, AtMost=1, Maximum=1.797693135e+308, Minimum=-1.797693135e+308, TreeAccess=False)
get_number_2 = GetNumber("2", AtLeast=1, AtMost=1, Maximum=1.797693135e+308, Minimum=-1.797693135e+308, TreeAccess=False)
get_number_3 = GetNumber(panel_6, AtLeast=1, AtMost=1, Maximum=1.797693135e+308, Minimum=-1.797693135e+308, TreeAccess=False)
get_number_4 = GetNumber("130", AtLeast=1, AtMost=1, Maximum=1.797693135e+308, Minimum=-1.797693135e+308, TreeAccess=False)
rval = GhPythonScript(uValue=get_number)  # -> out, resistance
# ---------- rval: Python ----------
__author__ = "jgamero"
__version__ = "2022.08.05"

import rhinoscriptsyntax as rs

resistance = 1 / uValue
# ---------- end rval ----------
panel_8 = Panel(get_number)
rval_2 = GhPythonScript(uValue=get_number_2)  # -> out, resistance; same code as rval
panel_9 = Panel(get_number_2)
panel_10 = Panel("G:\Mi unidad\Post-Doc DATAI\Investigación\Computational Design\_FractionalFactorialDesign\_results\_ViewCapture")
python_2 = GhPythonScript(kappa=get_number_3)  # -> out, density, spec_heat, thickness
# ---------- python_2: Python ----------
__author__ = "jgamero"
__version__ = "2022.08.31"

import rhinoscriptsyntax as rs

thickness = 0.0012
spec_heat = 435

spec_heat = spec_heat
thickness = thickness

numerator = kappa * 1000
denominator = thickness*spec_heat
density = numerator / denominator # kappa value is in Joules, not kiloJoules

print(kappa)
# ---------- end python_2 ----------
panel_11 = Panel(get_number_3)
python_3 = GhPythonScript(kappa=get_number_4)  # -> out, density, spec_heat, thickness
# ---------- python_3: Python ----------
__author__ = "jgamero"
__version__ = "2022.08.31"

import rhinoscriptsyntax as rs

thickness = 0.10
spec_heat = 800

spec_heat = spec_heat
thickness = thickness

numerator = kappa * 1000
denominator = thickness*spec_heat
density = numerator / denominator # kappa value is in Joules, not kiloJoules

print(kappa)
# ---------- end python_3 ----------
panel_12 = Panel(get_number_4)
panel_13 = Panel(rval.resistance)
conductivity = GhPythonScript(resistance=rval.resistance)  # -> out, conductivity
# ---------- conductivity: Python ----------
__author__ = "jgamero"
__version__ = "2022.08.05"

import rhinoscriptsyntax as rs

thickness = 0.0012
conductivity = thickness / resistance
# ---------- end conductivity ----------
conductivity_2 = GhPythonScript(resistance=rval_2.resistance)  # -> out, conductivity
# ---------- conductivity_2: Python ----------
__author__ = "jgamero"
__version__ = "2022.08.05"

import rhinoscriptsyntax as rs

thickness = 0.10
conductivity = thickness / resistance
# ---------- end conductivity_2 ----------
panel_14 = Panel(rval_2.resistance)
panel_15 = Panel(python_2.density)
panel_16 = Panel(python_3.density)
la_viewcapture = ViewCapture(DirectoryPath=panel_10, ImageFormat=0, ImageFilename=panel_2, ScaleFactor=1, Run=Toggle(False))  # -> ImagePath, ImagesList
panel_17 = Panel(conductivity.conductivity)
panel_18 = Panel(conductivity_2.conductivity)
opaquemat = HBOpaqueMaterial(
    thickness=python_2.thickness,
    conductivity=conductivity.conductivity,
    density=python_2.density,
    spec_heat=python_2.spec_heat,
    sol_absp="0.3")  # -> mat; plug-in component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
opaquemat_2 = HBOpaqueMaterial(
    thickness=python_3.thickness,
    conductivity=conductivity_2.conductivity,
    density=python_3.density,
    spec_heat=python_3.spec_heat,
    sol_absp="0.3")  # -> mat; plug-in component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
decnstrmat = HBDeconstructMaterial(mat=opaquemat)  # -> values, attr_names, r_val_si, r_val_ip; plug-in component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
decnstrmat_2 = HBDeconstructMaterial(mat=opaquemat_2)  # -> values, attr_names, r_val_si, r_val_ip; plug-in component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
searchmats = HBSearchMaterials(keywords="concrete")  # -> opaque_mats, window_mats; plug-in component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
panel_19 = Panel(decnstrmat.r_val_si)
panel_20 = Panel(decnstrmat_2.r_val_si)
opaqueconstr = HBOpaqueConstruction(name="roof", materials=opaquemat)  # -> constr; plug-in component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
# Full Factorial Design
panel_21 = Panel("ceramic tile")
# Se utilizó 2 porque se considerará
# un alpha de 0.3 (absortancia < 0.6) para
# zonas climáticas 3-8 del NBR 15575-4
opaqueconstr_2 = HBOpaqueConstruction(name="wall", materials=opaquemat_2)  # -> constr; plug-in component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
list = ItemSelector(
    searchmats.opaque_mats,
    {"100mm Normalweight concrete floor", "12 in. Normalweight Concrete Floor", "4 in. Normalweight Concrete Floor", "4 in. Normalweight Concrete Wall", "6 in. Heavyweight Concrete Roof", "6 in. Normalweight Concrete Floor", "8 in. Concrete Block Basement Wall", "8 in. Concrete Block Wall", "8 in. Normalweight Concrete Floor", "8 in. Normalweight Concrete Wall", "8IN CONCRETE HW RefBldg", "8IN Concrete HW", "Concrete Pavement", "Generic HW Concrete", "Generic LW Concrete", "HW CONCRETE", "HW CONCRETE 8 in", "M11 100mm lightweight concrete", "M15 200mm heavyweight concrete", "MAT-CC05 4 HW CONCRETE", "MAT-CC05 8 HW CONCRETE", "NACM_Concrete 4in_140lb/ft3"}, selected="100mm Normalweight concrete floor")
python_4 = GhPythonScript()  # -> out, a
# ---------- python_4: Python ----------
__author__ = "jgamero"
__version__ = "2022.08.05"

import rhinoscriptsyntax as rs

x = 0.11
y = 0.17
a = x/y
# ---------- end python_4 ----------
panel_22 = Panel(python_4.a)
opaquemat_3 = HBOpaqueMaterial(name=panel_21, thickness="0.00635", conductivity="0.85", density="2300", spec_heat="1000")  # -> mat; plug-in component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
opaquemat_4 = HBOpaqueMaterial(name="mortero adhesivo", thickness="0.003", conductivity="1.8", density="2000", spec_heat="1000")  # -> mat; plug-in component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
opaquemat_5 = HBOpaqueMaterial(name="10cm Concrete Block Hollowed", thickness="0.1", conductivity=python_4.a, density="1300", spec_heat="1000")  # -> mat; plug-in component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
decnstrconstr = HBDeconstructConstruction(constr=opaqueconstr)  # -> materials, layers, r_val_si, r_val_ip, u_fac_si, u_fac_ip, shgc, t_sol, t_vis; plug-in component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
# Se utilizó 2 porque se considerará
# un alpha de 0.3 (absortancia) para
# zonas climáticas 7 y 8 del NBR 15575-5
decnstrconstr_2 = HBDeconstructConstruction(constr=opaqueconstr_2)  # -> materials, layers, r_val_si, r_val_ip, u_fac_si, u_fac_ip, shgc, t_sol, t_vis; plug-in component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
merge = Merge(Data1=opaquemat_3, Data2=opaquemat_4, Data3=list)
panel_23 = Panel(decnstrconstr.u_fac_si)
merge_2 = Merge(Data1=opaquemat_5)
panel_24 = Panel(decnstrconstr.r_val_si)
panel_25 = Panel(decnstrconstr_2.u_fac_si)
panel_26 = Panel(decnstrconstr_2.r_val_si)
opaqueconstr_3 = HBOpaqueConstruction(name="interior", materials=merge_2)  # -> constr; plug-in component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
opaqueconstr_4 = HBOpaqueConstruction(name="floor", materials=merge)  # -> constr; plug-in component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
exteriorsubset = HBExteriorConstructionSubset(exterior_wall=opaqueconstr_2, exterior_roof=opaqueconstr)  # -> exterior_set; plug-in component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
groundsubset = HBGroundConstructionSubset(ground_floor=opaqueconstr_4)  # -> ground_set; plug-in component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
interiorsubset = HBInteriorConstructionSubset(interior_wall=opaqueconstr_3)  # -> interior_set; plug-in component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
constructionset = HBConstructionSet(exterior_subset=exteriorsubset, ground_subset=groundsubset, interior_subset=interiorsubset)  # -> constr_set; plug-in component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

# ---- group: General Programs
panel_27 = Panel("""0
0
0
0
0
0
1
1
0
0
0
0
0
0
0
0
0
0
0
0
0
0
1
1""")
panel_28 = Panel("""0
0
0
0
0
0
0
0
0
0
0
0
0
0
0
0
1
1
1
1
1
1
0
0""")
panel_29 = Panel("""1
1
1
1
1
1
1
1
1
1
1
1
1
1
1
1
1
1
1
1
1
1
1
1""")
constantschedule = HBConstantSchedule(values=panel_28, name="Sala_Comedor_Cocina_Lighting")  # -> report, schedule, idf_text; plug-in component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
constantschedule_2 = HBConstantSchedule(values=panel_27, name="Dorms_WC_Lighting")  # -> report, schedule, idf_text; plug-in component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
constantschedule_3 = HBConstantSchedule(values=panel_29, name="ASHRAE_Minimum_Fresh_Air")  # -> report, schedule, idf_text; plug-in component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
panel_30 = Panel("""0
0
0
0
0
0
0
0
0
0
0
0
0
0
0.5
0.5
0.5
0.5
1
1
1
1
0
0""")
panel_31 = Panel("""1
1
1
1
1
1
1
1
0
0
0
0
0
0
0
0
0
0
0
0
0
0
1
1""")
constantschedule_4 = HBConstantSchedule(values=panel_31, name="Dorms_WC_Occupancy")  # -> report, schedule, idf_text; plug-in component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
constantschedule_5 = HBConstantSchedule(values=panel_30, name="Sala_Comedor_Cocina_Occupancy")  # -> report, schedule, idf_text; plug-in component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
people = HBPeople(name="Dorms_WC", ppl_per_area="2", occupancy_sch=constantschedule_4.schedule)  # -> people; plug-in component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
infiltration = HBInfiltration(name="Dorms_WC", flow_per_ext_area="0.0006")  # -> infil; plug-in component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
lighting = HBLighting(name="Dorms_WC", watts_per_area="45", schedule=constantschedule_2.schedule, radiant_fract="0.3")  # -> lighting; plug-in component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
ventilation = HBVentilation(name="Dorms_WC", schedule=constantschedule_3.schedule)  # -> vent; plug-in component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
people_2 = HBPeople(name="Sala_Comedor_Cocina", ppl_per_area="2", occupancy_sch=constantschedule_5.schedule)  # -> people; plug-in component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
lighting_2 = HBLighting(name="Sala_Comedor_Cocina", watts_per_area="60", schedule=constantschedule.schedule, radiant_fract="0.3")  # -> lighting; plug-in component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
ventilation_2 = HBVentilation(name="Sala_Comedor_Cocina", schedule=constantschedule_3.schedule)  # -> vent; plug-in component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
infiltration_2 = HBInfiltration(name="Sala_Comedor_Cocina", flow_per_ext_area="0.0006")  # -> infil; plug-in component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
programtype = HBProgramType(name="Dorm_WC_Program", people=people, lighting=lighting, infiltration=infiltration)  # -> program; plug-in component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
programtype_2 = HBProgramType(name="Sala_Comedor_Cocina_Program", people=people_2, lighting=lighting_2, infiltration=infiltration_2)  # -> program; plug-in component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

# ----
toggle = BooleanToggle(True)
reflectance_for_clear_uncoated_glass = Panel("0.075")
transmittance_for_clear_uncoated_glass = Panel("0.85")
transmittance_for_clear_uncoated_glass_2 = Panel("0.85")
reflectance_for_clear_uncoated_glass_2 = Panel("0.075")
transmittance_for_clear_uncoated_glass_3 = Panel("0.85")
reflectance_for_clear_uncoated_glass_3 = Panel("0.075")
transmittance_for_clear_uncoated_glass_4 = Panel("0.85")
reflectance_for_clear_uncoated_glass_4 = Panel("0.075")
typical_thickness = Panel("0.003")
typical_thickness_2 = Panel("0.003")
typical_thickness_3 = Panel("0.003")
typical_thickness_4 = Panel("0.003")
versions = HBCheckVersions()  # -> lbt_gh, python, radiance, openstudio, energyplus; plug-in component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
transmod = HBTranslucentModifier(
    name="South Windows",
    diff_ref=reflectance_for_clear_uncoated_glass_3,
    diff_trans=transmittance_for_clear_uncoated_glass_3)  # -> modifier; plug-in component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
glassmat = HBGlassMaterial(
    name="South Windows",
    thickness=typical_thickness_4,
    transmittance=transmittance_for_clear_uncoated_glass_3,
    reflectance=reflectance_for_clear_uncoated_glass_3)  # -> mat; plug-in component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
transmod_2 = HBTranslucentModifier(
    name="North Windows",
    diff_ref=reflectance_for_clear_uncoated_glass_2,
    diff_trans=transmittance_for_clear_uncoated_glass_2)  # -> modifier; plug-in component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
transmod_3 = HBTranslucentModifier(
    name="East Windows",
    diff_ref=reflectance_for_clear_uncoated_glass_4,
    diff_trans=transmittance_for_clear_uncoated_glass_4)  # -> modifier; plug-in component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
glassmat_2 = HBGlassMaterial(
    name="East Windows",
    thickness=typical_thickness_3,
    transmittance=transmittance_for_clear_uncoated_glass_4,
    reflectance=reflectance_for_clear_uncoated_glass_4)  # -> mat; plug-in component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
transmod_4 = HBTranslucentModifier(name="West Windows", diff_ref=reflectance_for_clear_uncoated_glass, diff_trans=transmittance_for_clear_uncoated_glass)  # -> modifier; plug-in component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
glassmat_3 = HBGlassMaterial(
    name="North Windows",
    thickness=typical_thickness,
    transmittance=transmittance_for_clear_uncoated_glass_2,
    reflectance=reflectance_for_clear_uncoated_glass_2)  # -> mat; plug-in component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
glassmat_4 = HBGlassMaterial(
    name="West Windows",
    thickness=typical_thickness_2,
    transmittance=transmittance_for_clear_uncoated_glass,
    reflectance=reflectance_for_clear_uncoated_glass)  # -> mat; plug-in component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
panel_32 = Panel([versions.lbt_gh, versions.python, versions.radiance, versions.openstudio, versions.energyplus])
windowmat = HBWindowMaterial()  # -> mat; plug-in component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
windowconstr = HBWindowConstruction(name="window", materials=glassmat)  # -> constr; plug-in component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
windowconstr_2 = HBWindowConstruction(name="window", materials=glassmat_4)  # -> constr; plug-in component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
windowconstr_3 = HBWindowConstruction(name="window", materials=glassmat_2)  # -> constr; plug-in component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
windowconstr_4 = HBWindowConstruction(name="window", materials=glassmat_3)  # -> constr; plug-in component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

blindmat = HBBlindMaterial(name="Blinds", vertical=Toggle(True))  # -> mat; plug-in component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
windowconstrshd = HBWindowConstructionShade(name="IndoorShadesN", shd_material=blindmat, control_type="1", setpoint="350")  # -> constr; plug-in component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

blindmat_2 = HBBlindMaterial(name="Blinds", vertical=Toggle(True))  # -> mat; plug-in component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
windowconstrshd_2 = HBWindowConstructionShade(name="IndoorShadesS", shd_material=blindmat_2, control_type="1", setpoint="350")  # -> constr; plug-in component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

blindmat_3 = HBBlindMaterial(name="Blinds", vertical=Toggle(True))  # -> mat; plug-in component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
windowconstrshd_3 = HBWindowConstructionShade(name="IndoorShadeseE", shd_material=blindmat_3, control_type="1", setpoint="350")  # -> constr; plug-in component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

blindmat_4 = HBBlindMaterial(name="Blinds", vertical=Toggle(True))  # -> mat; plug-in component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
windowconstrshd_4 = HBWindowConstructionShade(name="IndoorShadesW", shd_material=blindmat_4, control_type="1", setpoint="350")  # -> constr; plug-in component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

shadesubset = HBShadeModifierSubset()  # -> shade_set; plug-in component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
modifierset = HBModifierSet(shade_subset=shadesubset)  # -> mod_set; plug-in component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
subtraction = Subtraction(A="1", B="0.3")
double_roof_1 = Panel("1")
no_double_roof_0 = Panel("0")
subtraction_2 = Subtraction(A="1", B="0.3")
brep = Brep(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)
brep_2 = Brep(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)
shadeconstr = HBShadeConstruction(sol_ref=subtraction)  # -> constr; plug-in component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
item_2 = ListItem(List=[brep_2, brep], Index=no_double_roof_0, Wrap=True)
shadeconstr_2 = HBShadeConstruction(sol_ref=subtraction_2)  # -> constr; plug-in component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
brep_3 = Brep(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)
brep_4 = Brep(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)
shade = HBShade(geo=item_2, ep_constr=shadeconstr)  # -> report, shades; plug-in component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
face = HBFace(geo=brep_4, name="East")  # -> report, faces; plug-in component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
face_2 = HBFace(geo=brep_3, name="South")  # -> report, faces; plug-in component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
vizwiref = HBVisualizeWireframe(hb_objs=flatten(face_2.faces))  # -> geo; plug-in component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
vizwiref_2 = HBVisualizeWireframe(hb_objs=flatten(face.faces))  # -> geo; plug-in component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
vizwiref_3 = HBVisualizeWireframe(hb_objs=flatten(shade.shades))  # -> geo; plug-in component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
searchmods = HBSearchMofidiers()  # -> modifiers; plug-in component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
window_height = Panel("1.2")
sill_height = Panel("1")
preview = CustomPreview(Geometry=vizwiref, Material=ColourSwatch(SwatchColor=RGB(0, 0, 0)))
preview_2 = CustomPreview(Geometry=vizwiref_2, Material=ColourSwatch(SwatchColor=RGB(0, 0, 0)))
window_height_2 = Panel("1.2")
sill_height_2 = Panel("1")
window_height_3 = Panel("1.2")
sill_height_3 = Panel("1")
window_height_4 = Panel("1.2")
sill_height_4 = Panel("1")
window_height_5 = Panel("1.2")
sill_height_5 = Panel("1")
window_height_6 = Panel("1.2")
sill_height_6 = Panel("1")
window_height_7 = Panel("1.2")
sill_height_7 = Panel("1")
sill_height_8 = Panel("1")
window_height_8 = Panel("1.2")
window_height_9 = Panel("1.2")
sill_height_9 = Panel("1")
preview_3 = CustomPreview(Geometry=vizwiref_3, Material=ColourSwatch(SwatchColor=RGB(0, 0, 0)))
brep_5 = Brep([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])
face_3 = HBFace(geo=brep_5, name="Living_Dining ")  # -> report, faces; plug-in component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
roomattr = HBRoomAttributes({"Display Name": "display_name", "Simulation Name (Identifier)": "identifier", "Multiplier": "multiplier", "Floor Area Excluded": "exclude_floor_area", "Story": "story", "Volume": "volume", "Gross Floor Area": "floor_area", "Exposed Area": "exposed_area", "Exterior Wall Area": "exterior_wall_area", "Exterior Aperture Area": "exterior_aperture_area", "Average Floor Elevation": "average_floor_height"}, selected="Display Name")
genes = GenePool(Decimals=0, Maximum=1, Minimum=0, Value=[1, 1, 1, 1, 1, 1, 1, 1, 0, 0, 0, 0, 0, 0, 1, 1, 1, 1, 1, 1, 1, 1, 1, 1])
panel_33 = Panel(genes)
constantschedule_6 = HBConstantSchedule(values=genes, name="Sala_Comedor_Cocina_NV")  # -> report, schedule, idf_text; plug-in component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
ventcontrol = HBVentilationControl(min_in_temp="19", delta_temp="0", schedule=constantschedule_6.schedule)  # -> vent_cntrl; plug-in component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
panel_34 = Panel(ventcontrol)
roomenergyattr = HBRoomEnergyAttributes({"Program": "properties.energy.program_type.display_name", "Construction Set": "properties.energy.construction_set.display_name", "Is Conditioned": "properties.energy.is_conditioned", "People per Area [ppl/m2]": "properties.energy.people.people_per_area", "Area per Person [m2/ppl]": "properties.energy.people.area_per_person", "Lighting per Area [W/m2]": "properties.energy.lighting.watts_per_area"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}, selected="Program")
faceenergyattr = HBFaceEnergyAttributes({"Construction": "properties.energy.construction.display_name", "Materials": "properties.energy.construction.layers", "Thickness [m]": "properties.energy.construction.thickness", "Density [kg/m2]": "properties.energy.construction.mass_area_density", "Heat Capacity [kg/K-m2]": "properties.energy.construction.area_heat_capacity", "R-Value [m2-K/W]": "properties.energy.construction.r_value", "U-Value [W/m2-K]": "properties.energy.construction.u_value", "U-Factor [W/m2-K]": "properties.energy.construction.u_factor", "SHGC [Unshaded]": "properties.energy.construction.shgc", "Solar Transmitance [Unshaded]": "properties.energy.construction.solar_transmittance", "Visible Transmitance [Unshaded]": "properties.energy.construction.visible_transmittance", "Solar Reflectance [Outside]": "properties.energy.construction.outside_solar_reflectance", "Solar Reflectance [Inside]": "properties.energy.construction.inside_solar_reflectance", "Fraction Area Operable": "properties.energy.vent_opening.fraction_area_operable", "Fraction Height Operable": "properties.energy.vent_opening.fraction_height_operable", "Discharge Coefficient": "properties.energy.vent_opening.discharge_coefficient"}, selected="R-Value [m2-K/W]")
faceattr = HBFaceAttributes({"Display Name": "display_name", "Simulation Name (Identifier)": "identifier", "Boundary Condition": "boundary_condition", "Has Parent": "has_parent", "Parent": "parent", "Area": "area", "Perimeter": "perimeter", "Face Type": "type", "Aperture Is Operable": "is_operable", "Door Is Glass": "is_glass"}, selected="Door Is Glass")
roomattr_2 = HBRoomAttributes({"Display Name": "display_name", "Simulation Name (Identifier)": "identifier", "Multiplier": "multiplier", "Floor Area Excluded": "exclude_floor_area", "Story": "story", "Volume": "volume", "Gross Floor Area": "floor_area", "Exposed Area": "exposed_area", "Exterior Wall Area": "exterior_wall_area", "Exterior Aperture Area": "exterior_aperture_area", "Average Floor Elevation": "average_floor_height"}, selected="Floor Area Excluded")
roomenergyattr_2 = HBRoomEnergyAttributes({"Program": "properties.energy.program_type.display_name", "Construction Set": "properties.energy.construction_set.display_name", "Is Conditioned": "properties.energy.is_conditioned", "People per Area [ppl/m2]": "properties.energy.people.people_per_area", "Area per Person [m2/ppl]": "properties.energy.people.area_per_person", "Lighting per Area [W/m2]": "properties.energy.lighting.watts_per_area"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}, selected="Construction Set")
faceenergyattr_2 = HBFaceEnergyAttributes({"Construction": "properties.energy.construction.display_name", "Materials": "properties.energy.construction.layers", "Thickness [m]": "properties.energy.construction.thickness", "Density [kg/m2]": "properties.energy.construction.mass_area_density", "Heat Capacity [kg/K-m2]": "properties.energy.construction.area_heat_capacity", "R-Value [m2-K/W]": "properties.energy.construction.r_value", "U-Value [W/m2-K]": "properties.energy.construction.u_value", "U-Factor [W/m2-K]": "properties.energy.construction.u_factor", "SHGC [Unshaded]": "properties.energy.construction.shgc", "Solar Transmitance [Unshaded]": "properties.energy.construction.solar_transmittance", "Visible Transmitance [Unshaded]": "properties.energy.construction.visible_transmittance", "Solar Reflectance [Outside]": "properties.energy.construction.outside_solar_reflectance", "Solar Reflectance [Inside]": "properties.energy.construction.inside_solar_reflectance", "Fraction Area Operable": "properties.energy.vent_opening.fraction_area_operable", "Fraction Height Operable": "properties.energy.vent_opening.fraction_height_operable", "Discharge Coefficient": "properties.energy.vent_opening.discharge_coefficient"}, selected="U-Factor [W/m2-K]")
roomattr_3 = HBRoomAttributes({"Display Name": "display_name", "Simulation Name (Identifier)": "identifier", "Multiplier": "multiplier", "Floor Area Excluded": "exclude_floor_area", "Story": "story", "Volume": "volume", "Gross Floor Area": "floor_area", "Exposed Area": "exposed_area", "Exterior Wall Area": "exterior_wall_area", "Exterior Aperture Area": "exterior_aperture_area", "Average Floor Elevation": "average_floor_height"}, selected="Multiplier")
faceattr_2 = HBFaceAttributes({"Display Name": "display_name", "Simulation Name (Identifier)": "identifier", "Boundary Condition": "boundary_condition", "Has Parent": "has_parent", "Parent": "parent", "Area": "area", "Perimeter": "perimeter", "Face Type": "type", "Aperture Is Operable": "is_operable", "Door Is Glass": "is_glass"}, selected="Display Name")
faceradianceattr = HBFaceRadianceAttributes({"Modifier": "properties.radiance.modifier.display_name", "Average Reflectance": "properties.radiance.modifier.average_reflectance", "Average Transmittance": "properties.radiance.modifier.average_transmittance", "Modifier Blk": "properties.radiance.modifier_blk.display_name", "Is Opaque": "properties.radiance.is_opaque", "Dynamic Group": "properties.radiance.dynamic_group_identifier", "State Count": "properties.radiance.state_count", "States": "properties.radiance.states"}, selected="Dynamic Group")
roomenergyattr_3 = HBRoomEnergyAttributes({"Program": "properties.energy.program_type.display_name", "Construction Set": "properties.energy.construction_set.display_name", "Is Conditioned": "properties.energy.is_conditioned", "People per Area [ppl/m2]": "properties.energy.people.people_per_area", "Area per Person [m2/ppl]": "properties.energy.people.area_per_person", "Lighting per Area [W/m2]": "properties.energy.lighting.watts_per_area"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}, selected="Occupancy Schedule": "properties.energy.people.occupancy_schedule.display_name")
faceenergyattr_3 = HBFaceEnergyAttributes({"Construction": "properties.energy.construction.display_name", "Materials": "properties.energy.construction.layers", "Thickness [m]": "properties.energy.construction.thickness", "Density [kg/m2]": "properties.energy.construction.mass_area_density", "Heat Capacity [kg/K-m2]": "properties.energy.construction.area_heat_capacity", "R-Value [m2-K/W]": "properties.energy.construction.r_value", "U-Value [W/m2-K]": "properties.energy.construction.u_value", "U-Factor [W/m2-K]": "properties.energy.construction.u_factor", "SHGC [Unshaded]": "properties.energy.construction.shgc", "Solar Transmitance [Unshaded]": "properties.energy.construction.solar_transmittance", "Visible Transmitance [Unshaded]": "properties.energy.construction.visible_transmittance", "Solar Reflectance [Outside]": "properties.energy.construction.outside_solar_reflectance", "Solar Reflectance [Inside]": "properties.energy.construction.inside_solar_reflectance", "Fraction Area Operable": "properties.energy.vent_opening.fraction_area_operable", "Fraction Height Operable": "properties.energy.vent_opening.fraction_height_operable", "Discharge Coefficient": "properties.energy.vent_opening.discharge_coefficient"}, selected="Visible Transmitance [Unshaded]")
roomattr_4 = HBRoomAttributes({"Display Name": "display_name", "Simulation Name (Identifier)": "identifier", "Multiplier": "multiplier", "Floor Area Excluded": "exclude_floor_area", "Story": "story", "Volume": "volume", "Gross Floor Area": "floor_area", "Exposed Area": "exposed_area", "Exterior Wall Area": "exterior_wall_area", "Exterior Aperture Area": "exterior_aperture_area", "Average Floor Elevation": "average_floor_height"}, selected="Display Name")
colrange = LBColorRange(index="1")  # -> colors; plug-in component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
legendpar = LBLegendParameters(colors=colrange, text_height="0.5")  # -> leg_par; plug-in component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
versioner = LBVersioner(update=Button())  # -> Vviiiiiz; plug-in component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
# Temperatura exterior
panel_35 = Panel("https://climate.onebuilding.org/WMO_Region_4_North_and_Central_America/HND_Honduras/CR_Cortes/HND_CR_La.Lima-Morales.Intl.AP.787080_TMYx.2007-2021.zip")
item_3 = ListItem(List=panel_35, Index=0, Wrap=True)
downloadepw = LBDownloadWeather(weather_URL=item_3)  # -> epw_file, stat_file, ddy_file; plug-in component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
panel_36 = Panel(downloadepw.epw_file)
importepw = LBImportEPW(epw_file=downloadepw.epw_file)  # -> location, dry_bulb_temperature, dew_point_temperature, relative_humidity, wind_speed, wind_direction, direct_normal_rad, diffuse_horizontal_rad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; plug-in component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
# Temperatura exterior
panel_37 = Panel("G:\Mi unidad\Post-Doc DATAI\Investigación\Computational Design\_OutdoorTemp\SPS\SPS_trm_2007-2021.csv")
toggle_2 = BooleanToggle(True)
item_4 = ListItem(List=panel_37, Index=0, Wrap=True)
panel_38 = Panel(item_4)
sizingpar = HBSizingParameter(ddy_file=downloadepw.ddy_file, heating_fac="1", cooling_fac="1")  # -> sizing; plug-in component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
file_2 = ReadFile(File=item_4, PerLineParse=True)
simoutput = HBSimulationOutput(zone_energy_use=toggle_2, comfort_metrics=toggle_2, load_type="all", report_frequency="hourly")  # -> report, sim_output; plug-in component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
flatten_2 = FlattenTree(Tree=file_2, Path="{0}")
panel_39 = Panel(flatten_2)
simpar = HBSimulationParameter(output=simoutput.sim_output, timestep=6, sizing=sizingpar)  # -> sim_par; plug-in component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

expression = Expression(Trm=flatten_2, Expression="Trm*0.31 + 17.8 + 3.5")
avr = Average(Input=expression)
panel_40 = Panel(avr)
panel_41 = Panel(expression)

expression_2 = Expression(Trm=flatten_2, Expression="Trm*0.31 + 17.8 -100")
expression_3 = Expression(Trm=flatten_2, Expression="Trm*0.31 + 17.8")
panel_42 = Panel(expression_3)
avr_2 = Average(Input=expression_3)

# ---- group: Legends
colrange_2 = LBColorRange(index=Slider(0, range=0..26))  # -> colors; plug-in component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
legendpar_2 = LBLegendParameters(colors=colrange_2)  # -> leg_par; plug-in component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
pt = Point(<point referenced from the Rhino model>)
hourlyplot = LBHourlyPlot(data=importepw.relative_humidity, base_pt=pt, x_dim="0.3", legend_par=legendpar_2)  # -> report, mesh, legend, borders, labels, title, vis_set; plug-in component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

colrange_3 = LBColorRange(index=Slider(0, range=0..26))  # -> colors; plug-in component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
legendpar_3 = LBLegendParameters(min="0", max="12", colors=colrange_3)  # -> leg_par; plug-in component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
pt_2 = Point(<point referenced from the Rhino model>)
hourlyplot_2 = LBHourlyPlot(data=importepw.wind_speed, base_pt=pt_2, x_dim="0.3", legend_par=legendpar_3)  # -> report, mesh, legend, borders, labels, title, vis_set; plug-in component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

colrange_4 = LBColorRange(index=Slider(0, range=0..26))  # -> colors; plug-in component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
legendpar_4 = LBLegendParameters(colors=colrange_4)  # -> leg_par; plug-in component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
pt_3 = Point(<point referenced from the Rhino model>)
hourlyplot_3 = LBHourlyPlot(data=importepw.dry_bulb_temperature, base_pt=pt_3, x_dim="0.3", legend_par=legendpar_4)  # -> report, mesh, legend, borders, labels, title, vis_set; plug-in component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

# ----
pt_4 = Point(<point referenced from the Rhino model>)

# ---- group: Legends
colrange_5 = LBColorRange(index=Slider(0, range=0..26))  # -> colors; plug-in component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
legendpar_5 = LBLegendParameters(colors=colrange_5)  # -> leg_par; plug-in component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
hourlyplot_4 = LBHourlyPlot(data=importepw.global_horizontal_rad, base_pt=pt_4, x_dim="0.3", legend_par=legendpar_5)  # -> report, mesh, legend, borders, labels, title, vis_set; plug-in component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

# ----
panel_43 = Panel(avr_2)
colrange_6 = LBColorRange(index="13")  # -> colors; plug-in component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
legendpar_6 = LBLegendParameters(min="0", max="20", colors=colrange_6, continuous_leg=Toggle(True), num_decimals="1", text_height="0.4")  # -> leg_par; plug-in component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
preview_4 = CustomPreview(Geometry=[hourlyplot.legend, hourlyplot.borders], Material=ColourSwatch(SwatchColor=RGB(0, 0, 0)))
preview_5 = CustomPreview(Geometry=[hourlyplot_3.legend, hourlyplot_3.borders], Material=ColourSwatch(SwatchColor=RGB(0, 0, 0)))
preview_6 = CustomPreview(Geometry=[hourlyplot_2.legend, hourlyplot_2.borders], Material=ColourSwatch(SwatchColor=RGB(0, 0, 0)))
preview_7 = CustomPreview(Geometry=[hourlyplot_4.legend, hourlyplot_4.borders], Material=ColourSwatch(SwatchColor=RGB(0, 0, 0)))
vizquick = HBVisualizeQuick()  # -> geo; plug-in component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
panel_44 = Panel("type: Percentage of Indoor Overheating Hours")

# ----
# Response Surface Modelling
number_slider = Slider(2, range=0..10)
wwr_w_center_points = Panel("""0.15
0.0505
0.047225""")
wwr_s_center_points = Panel("""0.4
0.3353
0.2356""")
roofovrhng_s_w_center_points = Panel("""2.5
2.9580
3.5130""")
expdesign = ValueList({"0", "1", "2", "3", "4", "5", "6", "7"}, selected="6")
value = ListItem(List=roofovrhng_s_w_center_points, Index=number_slider, Wrap=True)
centers = ListItem(List=wwr_w_center_points, Index=number_slider, Wrap=True)
centers_2 = ListItem(List=wwr_s_center_points, Index=number_slider, Wrap=True)
colibri_in_2 = ColibriInputsIterator(ExpDesign=expdesign, ignoreAllWarningMsg=True)  # -> U, IP, ExpDesign, V_N
panel_45 = Panel("""dsg_fo_1
dsg_fo_2
dsg_fo_3
dsg_fo_4
dsg_fo_5
dsg_so_1
dsg_so_Opt
dsg_so_2""")
item_5 = ListItem(List=panel_45, Index=colibri_in_2.ExpDesign, Wrap=True)
wwr_s_steps = Panel("""0.1
0.1
0.1""")
roofovrhng_s_w_steps = Panel("""0.5
0.5
0.25""")
wwr_w_steps = Panel("""0.1
0.025
0.025""")
panel_46 = Panel(item_5)
sa1 = Slider(12, range=1..12)
so = Slider(17, range=1..17)
panel_47 = Panel("G:\Mi unidad\Post-Doc DATAI\Investigación\Computational Design/_FractionalFactorialDesign/CCD/")
concat = Concatenate(FragmentA=panel_46, FragmentB=".csv")
panel_48 = Panel(concat)
centers_3 = ListItem(List=wwr_w_steps, Index=number_slider, Wrap=True)
centers_4 = ListItem(List=roofovrhng_s_w_steps, Index=number_slider, Wrap=True)
opt = ValueList({"1"}, selected="1")
centers_5 = ListItem(List=wwr_s_steps, Index=number_slider, Wrap=True)
concat_2 = Concatenate(FragmentA=panel_47, FragmentB=panel_48)

# ---- group: RSM
fo = Slider(11, range=1..11)
colibri_in_3 = ColibriInputsIterator(Opt=opt, ignoreAllWarningMsg=True)  # -> U, IP, Opt, V_N
item_6 = ListItem(List=concat_2, Index=Slider(0, range=0..7), Wrap=True)
panel_49 = Panel(colibri_in_3.U)
file_3 = ReadFile(File=item_6, PerLineParse=True)
panel_50 = Panel(item_6)
item_7 = ListItem(List=file_3, Index=colibri_in_3.Opt, Wrap=True)
flatten_3 = FlattenTree(Tree=item_7, Path="{0}")
panel_51 = Panel(file_3)
panel_52 = Panel(flatten_3)
python_5 = GhPythonScript(x=flatten_3, value=value, step=centers_4)  # -> out, RoofOvrhng_S_W
# ---------- python_5: Python ----------
__author__ = "jgamero"
__version__ = "2024.06.25"

import rhinoscriptsyntax as rs

RoofOvrhng_S_W = x
RoofOvrhng_S_W = RoofOvrhng_S_W.split(",")[-7]

RoofOvrhng_S_W = float(RoofOvrhng_S_W)

RoofOvrhng_S_W = (float(step)*RoofOvrhng_S_W) + float(value)
# ---------- end python_5 ----------

# ----
python_6 = GhPythonScript(x=flatten_3, value=centers, step=centers_3)  # -> out, WWR_W
# ---------- python_6: Python ----------
__author__ = "jgamero"
__version__ = "2024.02.29"

import rhinoscriptsyntax as rs

WWR_W = x
WWR_W = WWR_W.split(",")[-6]

WWR_W = float(WWR_W)

WWR_W = (float(step)*WWR_W) + float(value)
# ---------- end python_6 ----------
python_7 = GhPythonScript(x=flatten_3, value=centers_2, step=centers_5)  # -> out, WWR_S
# ---------- python_7: Python ----------
__author__ = "jgamero"
__version__ = "2024.02.29"

import rhinoscriptsyntax as rs

WWR_S = x
WWR_S = WWR_S.split(",")[-5]

WWR_S = float(WWR_S)

WWR_S = (float(step)*WWR_S) + float(value)
# ---------- end python_7 ----------

python_8 = GhPythonScript(x=flatten_3)  # -> out, WWR_N, WWR_E, RoofOvrhng_N, RoofOvrhng_E
# ---------- python_8: Python ----------
__author__ = "jgamero"
__version__ = "2024.06.25"

import rhinoscriptsyntax as rs

WWR_N = x
WWR_N = WWR_N.split(",")[-4]

WWR_E = x
WWR_E = WWR_E.split(",")[-3]

RoofOvrhng_N = x
RoofOvrhng_N = RoofOvrhng_N.split(",")[-2]

RoofOvrhng_E = x
RoofOvrhng_E = RoofOvrhng_E.split(",")[-1]
# ---------- end python_8 ----------

la_viewcapture_2 = ViewCapture(DirectoryPath=panel_7, ImageFormat=0, ImageFilename=panel_49, ScaleFactor=1, Run=Toggle(True))  # -> ImagePath, ImagesList
panel_53 = Panel(python_7.WWR_S)
panel_54 = Panel(python_6.WWR_W)
panel_55 = Panel(python_5.RoofOvrhng_S_W)
panel_56 = Panel([python_8.WWR_N, python_8.WWR_E, python_8.RoofOvrhng_N, python_8.RoofOvrhng_E])
north = FlattenTree(Tree=python_8.RoofOvrhng_N, Path="{0}")
south = FlattenTree(Tree=python_5.RoofOvrhng_S_W, Path="{0}")
east = FlattenTree(Tree=python_8.RoofOvrhng_E, Path="{0}")
west = FlattenTree(Tree=python_5.RoofOvrhng_S_W, Path="{0}")
north_roof_overhang = Panel(north)
south_roof_overhang = Panel(south)
west_roof_overhang = Panel(west)
east_roof_overhang = Panel(east)

pflip = FlipPlane(Plane=PlaneXY(0, 0, 0), ReverseX=Toggle(False), ReverseY=False, SwapAxes=True)
pflip_2 = FlipPlane(Plane=PlaneXY(0, 0, 0), ReverseX=Toggle(True), ReverseY=False, SwapAxes=True)
crv = Curve(<curve referenced from the Rhino model>)
crv_2 = Curve(<curve referenced from the Rhino model>)
offset = OffsetCurve(Curve=crv, Distance=west_roof_overhang, Plane=pflip, Corners=1)
offset_2 = OffsetCurve(Curve=crv_2, Distance=east_roof_overhang, Plane=pflip_2, Corners=1)
divide = DivideCurve(Curve=offset, Count="1", Kinks=toggle)  # -> Points, Tangents, Parameters
divide_2 = DivideCurve(Curve=offset_2, Count="1", Kinks=toggle)  # -> Points, Tangents, Parameters
pull = PullPoint(Point=divide.Points, Geometry=[<curve referenced from the Rhino model> x2], ClosestOnly=True)  # -> ClosestPoint, Distance
pull_2 = PullPoint(Point=divide_2.Points, Geometry=[<curve referenced from the Rhino model> x2], ClosestOnly=True)  # -> ClosestPoint, Distance
ln = Line(StartPoint=pull.ClosestPoint, EndPoint=divide.Points)
ln_2 = Line(StartPoint=pull_2.ClosestPoint, EndPoint=divide_2.Points)
loft = Loft(Curves=ln, Options={Adjust=False, Closed=False, LoftEnds=0, LoftSimp=0, LoftType=3, Rebuild=10, Refit=0.01})
loft_2 = Loft(Curves=ln_2, Options={Adjust=False, Closed=False, LoftEnds=0, LoftSimp=0, LoftType=3, Rebuild=10, Refit=0.01})

east_wwr = Panel(python_8.WWR_E)
north_wwr = Panel(python_8.WWR_N)
west_wwr = Panel(python_6.WWR_W)
south_wwr = Panel(python_7.WWR_S)
aperturesbyratio = HBAperturesByRatio(
    hb_objs=flatten(face_2.faces),
    ratio=south_wwr,
    win_height=window_height_8,
    sill_height=sill_height_8,
    operable=Toggle(True))  # -> report, hb_objs; plug-in component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
aperturesbyratio_2 = HBAperturesByRatio(
    hb_objs=flatten(face.faces),
    ratio=east_wwr,
    win_height=window_height_9,
    sill_height=sill_height_9,
    operable=Toggle(True))  # -> report, hb_objs; plug-in component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
applywindowconstr = HBApplyWindowConstruction(hb_objs=flatten(aperturesbyratio_2.hb_objs), constr=windowconstr_3)  # -> hb_objs; plug-in component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
applywindowmod = HBApplyWindowModifier(hb_objs=flatten(applywindowconstr), mod=transmod_3)  # -> hb_objs; plug-in component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
applywindowconstr_2 = HBApplyWindowConstruction(hb_objs=flatten(aperturesbyratio.hb_objs), constr=windowconstr)  # -> hb_objs; plug-in component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
applywindowmod_2 = HBApplyWindowModifier(hb_objs=flatten(applywindowconstr_2), mod=transmod)  # -> hb_objs; plug-in component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
room = HBRoom(
    faces=flatten([face_3.faces, applywindowmod, applywindowmod_2]),
    name="Living_Dining ",
    constr_set=constructionset,
    program=programtype_2,
    conditioned=Toggle(False))  # -> report, room; plug-in component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
vizwiref_4 = HBVisualizeWireframe(hb_objs=flatten(room.room))  # -> geo; plug-in component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
preview_8 = CustomPreview(Geometry=vizwiref_4, Material=ColourSwatch(SwatchColor=RGB(0, 0, 0)))

python_9 = GhPythonScript()  # -> out, slope
# ---------- python_9: Python ----------
__author__ = "jgamero"
__version__ = "2022.12.21"

import rhinoscriptsyntax as rs

height = 0.7
length = 3
slope = height / length
# ---------- end python_9 ----------
panel_57 = Panel(python_9.slope)
get_number_5 = GetNumber(north_roof_overhang, AtLeast=1, AtMost=1, Maximum=1.797693135e+308, Minimum=-1.797693135e+308, TreeAccess=False)
get_number_6 = GetNumber(panel_57, AtLeast=1, AtMost=1, Maximum=1.797693135e+308, Minimum=-1.797693135e+308, TreeAccess=False)
python_10 = GhPythonScript(slope=get_number_6, length=get_number_5)  # -> out, height
# ---------- python_10: Python ----------
__author__ = "jgamero"
__version__ = "2022.12.21"

import rhinoscriptsyntax as rs

slope = 0.2333333
length

height = slope * length
# ---------- end python_10 ----------

num = Number(python_10.height)
expression_4 = Expression(x=num, y=Slider(2, range=0..10), Expression="Round(x,y)")
panel_58 = Panel(expression_4)

north_slope = Panel(expression_4)

X = UnitX(Factor=west_roof_overhang)
rev = Reverse(Vector=X)
pt_5 = Point(<point referenced from the Rhino model>)
Z = UnitZ(Factor=north_slope)
move = Move(Geometry=pt_5, Motion=rev)  # -> Geometry, Transform
rev_2 = Reverse(Vector=Z)
pflip_3 = FlipPlane(Plane=PlaneXY(0, 0, 0), ReverseX=Toggle(True), ReverseY=False, SwapAxes=True)
fline = FitLine(Points=[pt_5, move.Geometry])
offset_3 = OffsetCurve(Curve=fline, Distance=north_roof_overhang, Plane=pflip_3, Corners=1)
move_2 = Move(Geometry=offset_3, Motion=rev_2)  # -> Geometry, Transform
divide_3 = DivideCurve(Curve=move_2.Geometry, Count="1", Kinks=False)  # -> Points, Tangents, Parameters
divide_4 = DivideCurve(Curve=fline, Count="1", Kinks=False)  # -> Points, Tangents, Parameters
ln_3 = Line(StartPoint=divide_4.Points, EndPoint=divide_3.Points)
loft_3 = Loft(Curves=ln_3, Options={Adjust=False, Closed=False, LoftEnds=0, LoftSimp=0, LoftType=3, Rebuild=10, Refit=0.01})

Z_2 = UnitZ(Factor=expression_4)

X_2 = UnitX(Factor=east_roof_overhang)
pt_6 = Point(<point referenced from the Rhino model>)
Z_3 = UnitZ(Factor=north_slope)
move_3 = Move(Geometry=pt_6, Motion=X_2)  # -> Geometry, Transform
rev_3 = Reverse(Vector=Z_3)
pflip_4 = FlipPlane(Plane=PlaneXY(0, 0, 0), ReverseX=Toggle(False), ReverseY=False, SwapAxes=True)
fline_2 = FitLine(Points=[pt_6, move_3.Geometry])
offset_4 = OffsetCurve(Curve=fline_2, Distance=north_roof_overhang, Plane=pflip_4, Corners=1)
move_4 = Move(Geometry=offset_4, Motion=rev_3)  # -> Geometry, Transform
divide_5 = DivideCurve(Curve=move_4.Geometry, Count="1", Kinks=False)  # -> Points, Tangents, Parameters
divide_6 = DivideCurve(Curve=fline_2, Count="1", Kinks=False)  # -> Points, Tangents, Parameters
ln_4 = Line(StartPoint=divide_6.Points, EndPoint=divide_5.Points)
loft_4 = Loft(Curves=ln_4, Options={Adjust=False, Closed=False, LoftEnds=0, LoftSimp=0, LoftType=3, Rebuild=10, Refit=0.01})

rev_4 = Reverse(Vector=Z_2)

python_11 = GhPythonScript()  # -> out, slope; same code as python_9
panel_59 = Panel(python_11.slope)
get_number_7 = GetNumber(south_roof_overhang, AtLeast=1, AtMost=1, Maximum=1.797693135e+308, Minimum=-1.797693135e+308, TreeAccess=False)
get_number_8 = GetNumber(panel_59, AtLeast=1, AtMost=1, Maximum=1.797693135e+308, Minimum=-1.797693135e+308, TreeAccess=False)
python_12 = GhPythonScript(slope=get_number_8, length=get_number_7)  # -> out, height; same code as python_10

num_2 = Number(python_12.height)
expression_5 = Expression(x=num_2, y=Slider(2, range=0..10), Expression="Round(x,y)")
panel_60 = Panel(expression_5)

south_slope = Panel(expression_5)

xy = XYPlane(Origin=Point(0, 0, 0))
Z_4 = UnitZ(Factor=expression_5)
pflip_5 = FlipPlane(Plane=xy, ReverseX=False, ReverseY=False, SwapAxes=True)
crv_3 = Curve(<curve referenced from the Rhino model>)
crv_4 = Curve(<curve referenced from the Rhino model>)
rev_5 = Reverse(Vector=Z_4)
offset_5 = OffsetCurve(Curve=crv_3, Distance=north_roof_overhang, Corners=1)
offset_6 = OffsetCurve(Curve=crv_4, Distance=south_roof_overhang, Plane=pflip_5, Corners=1)
move_5 = Move(Geometry=offset_6, Motion=rev_5)  # -> Geometry, Transform
move_6 = Move(Geometry=offset_5, Motion=rev_4)  # -> Geometry, Transform
divide_7 = DivideCurve(Curve=move_6.Geometry, Count="1", Kinks=False)  # -> Points, Tangents, Parameters
divide_8 = DivideCurve(Curve=move_5.Geometry, Count="1", Kinks=False)  # -> Points, Tangents, Parameters
pull_3 = PullPoint(Point=divide_7.Points, Geometry=<curve referenced from the Rhino model>, ClosestOnly=True)  # -> ClosestPoint, Distance
pull_4 = PullPoint(Point=divide_8.Points, Geometry=<curve referenced from the Rhino model>, ClosestOnly=True)  # -> ClosestPoint, Distance
ln_5 = Line(StartPoint=pull_3.ClosestPoint, EndPoint=divide_7.Points)
ln_6 = Line(StartPoint=pull_4.ClosestPoint, EndPoint=divide_8.Points)
loft_5 = Loft(Curves=ln_6, Options={Adjust=False, Closed=False, LoftEnds=0, LoftSimp=0, LoftType=3, Rebuild=10, Refit=0.01})
loft_6 = Loft(Curves=ln_5, Options={Adjust=False, Closed=False, LoftEnds=0, LoftSimp=0, LoftType=3, Rebuild=10, Refit=0.01})

X_3 = UnitX(Factor=west_roof_overhang)
rev_6 = Reverse(Vector=X_3)
pt_7 = Point(<point referenced from the Rhino model>)
Z_5 = UnitZ(Factor=south_slope)
move_7 = Move(Geometry=pt_7, Motion=rev_6)  # -> Geometry, Transform
rev_7 = Reverse(Vector=Z_5)
pflip_6 = FlipPlane(Plane=PlaneXY(0, 0, 0), ReverseX=Toggle(False), ReverseY=False, SwapAxes=True)
fline_3 = FitLine(Points=[pt_7, move_7.Geometry])
offset_7 = OffsetCurve(Curve=fline_3, Distance=south_roof_overhang, Plane=pflip_6, Corners=1)
move_8 = Move(Geometry=offset_7, Motion=rev_7)  # -> Geometry, Transform
divide_9 = DivideCurve(Curve=move_8.Geometry, Count="1", Kinks=False)  # -> Points, Tangents, Parameters
divide_10 = DivideCurve(Curve=fline_3, Count="1", Kinks=False)  # -> Points, Tangents, Parameters
ln_7 = Line(StartPoint=divide_10.Points, EndPoint=divide_9.Points)
loft_7 = Loft(Curves=ln_7, Options={Adjust=False, Closed=False, LoftEnds=0, LoftSimp=0, LoftType=3, Rebuild=10, Refit=0.01})

X_4 = UnitX(Factor=east_roof_overhang)
pt_8 = Point(<point referenced from the Rhino model>)
Z_6 = UnitZ(Factor=south_slope)
move_9 = Move(Geometry=pt_8, Motion=X_4)  # -> Geometry, Transform
rev_8 = Reverse(Vector=Z_6)
pflip_7 = FlipPlane(Plane=PlaneXY(0, 0, 0), ReverseX=Toggle(False), ReverseY=False, SwapAxes=True)
fline_4 = FitLine(Points=[move_9.Geometry, pt_8])
offset_8 = OffsetCurve(Curve=fline_4, Distance=south_roof_overhang, Plane=pflip_7, Corners=1)
move_10 = Move(Geometry=offset_8, Motion=rev_8)  # -> Geometry, Transform
divide_11 = DivideCurve(Curve=move_10.Geometry, Count="1", Kinks=False)  # -> Points, Tangents, Parameters
divide_12 = DivideCurve(Curve=fline_4, Count="1", Kinks=False)  # -> Points, Tangents, Parameters
ln_8 = Line(StartPoint=divide_12.Points, EndPoint=divide_11.Points)
loft_8 = Loft(Curves=ln_8, Options={Adjust=False, Closed=False, LoftEnds=0, LoftSimp=0, LoftType=3, Rebuild=10, Refit=0.01})

brep_6 = Brep([loft, loft_2, loft_5, loft_6, loft_8, loft_4, loft_7, loft_3])
mesh = MeshBrep(
    Brep=brep_6,
    Settings={GridMaxCount=0, GridMinCount=16, JaggedSeams=False, MaxEdgeLength=0, MinEdgeLength=0.0001, MinTolerance=0, Refine=True, RefineAngle=0, RelativeTolerance=0.65, SimplePlanes=True, Tolerance=0})
shade_2 = HBShade(geo=mesh, ep_constr=shadeconstr_2)  # -> report, shades; plug-in component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
vizwiref_5 = HBVisualizeWireframe(hb_objs=flatten(shade_2.shades))  # -> geo; plug-in component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
preview_9 = CustomPreview(Geometry=vizwiref_5, Material=ColourSwatch(SwatchColor=RGB(0, 0, 0)))

brep_7 = Brep(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)
face_4 = HBFace(geo=brep_7, name="North")  # -> report, faces; plug-in component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
vizwiref_6 = HBVisualizeWireframe(hb_objs=flatten(face_4.faces))  # -> geo; plug-in component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
preview_10 = CustomPreview(Geometry=vizwiref_6, Material=ColourSwatch(SwatchColor=RGB(0, 0, 0)))
brep_8 = Brep([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])
aperturesbyratio_3 = HBAperturesByRatio(hb_objs=flatten(face_4.faces), ratio=north_wwr, win_height=window_height, sill_height=sill_height, operable=Toggle(True))  # -> report, hb_objs; plug-in component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
face_5 = HBFace(geo=brep_8, name="WC ")  # -> report, faces; plug-in component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

applywindowconstr_3 = HBApplyWindowConstruction(hb_objs=flatten(aperturesbyratio_3.hb_objs), constr=windowconstr_4)  # -> hb_objs; plug-in component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
applywindowmod_3 = HBApplyWindowModifier(hb_objs=flatten(applywindowconstr_3), mod=transmod_2)  # -> hb_objs; plug-in component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

room_2 = HBRoom(
    faces=flatten([face_5.faces, applywindowmod_3]),
    name="WC ",
    constr_set=constructionset,
    program=programtype,
    conditioned=Toggle(False))  # -> report, room; plug-in component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
vizwiref_7 = HBVisualizeWireframe(hb_objs=flatten(room_2.room))  # -> geo; plug-in component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
preview_11 = CustomPreview(Geometry=vizwiref_7, Material=ColourSwatch(SwatchColor=RGB(0, 0, 0)))

brep_9 = Brep(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)
brep_10 = Brep(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)
face_6 = HBFace(geo=brep_9, name="North")  # -> report, faces; plug-in component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
face_7 = HBFace(geo=brep_10, name="East")  # -> report, faces; plug-in component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
vizwiref_8 = HBVisualizeWireframe(hb_objs=flatten(face_6.faces))  # -> geo; plug-in component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
vizwiref_9 = HBVisualizeWireframe(hb_objs=flatten(face_7.faces))  # -> geo; plug-in component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
preview_12 = CustomPreview(Geometry=vizwiref_8, Material=ColourSwatch(SwatchColor=RGB(0, 0, 0)))
preview_13 = CustomPreview(Geometry=vizwiref_9, Material=ColourSwatch(SwatchColor=RGB(0, 0, 0)))
brep_11 = Brep([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])
aperturesbyratio_4 = HBAperturesByRatio(
    hb_objs=flatten(face_6.faces),
    ratio=north_wwr,
    win_height=window_height_2,
    sill_height=sill_height_2,
    operable=Toggle(True))  # -> report, hb_objs; plug-in component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
aperturesbyratio_5 = HBAperturesByRatio(
    hb_objs=flatten(face_7.faces),
    ratio=east_wwr,
    win_height=window_height_3,
    sill_height=sill_height_3,
    operable=Toggle(True))  # -> report, hb_objs; plug-in component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
face_8 = HBFace(geo=brep_11, name="Bedroom_1 ")  # -> report, faces; plug-in component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

applywindowconstr_4 = HBApplyWindowConstruction(hb_objs=flatten(aperturesbyratio_5.hb_objs), constr=windowconstr_3)  # -> hb_objs; plug-in component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
applywindowmod_4 = HBApplyWindowModifier(hb_objs=flatten(applywindowconstr_4), mod=transmod_3)  # -> hb_objs; plug-in component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
applywindowconstr_5 = HBApplyWindowConstruction(hb_objs=flatten(aperturesbyratio_4.hb_objs), constr=windowconstr_4)  # -> hb_objs; plug-in component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
applywindowmod_5 = HBApplyWindowModifier(hb_objs=flatten(applywindowconstr_5), mod=transmod_2)  # -> hb_objs; plug-in component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

room_3 = HBRoom(
    faces=flatten([face_8.faces, applywindowmod_5, applywindowmod_4]),
    name="Bedroom_1 ",
    constr_set=constructionset,
    program=programtype,
    conditioned=Toggle(False))  # -> report, room; plug-in component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
vizwiref_10 = HBVisualizeWireframe(hb_objs=flatten(room_3.room))  # -> geo; plug-in component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
preview_14 = CustomPreview(Geometry=vizwiref_10, Material=ColourSwatch(SwatchColor=RGB(0, 0, 0)))

brep_12 = Brep(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)
brep_13 = Brep(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)
face_9 = HBFace(geo=brep_13, name="West")  # -> report, faces; plug-in component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
face_10 = HBFace(geo=brep_12, name="South")  # -> report, faces; plug-in component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
vizwiref_11 = HBVisualizeWireframe(hb_objs=flatten(face_10.faces))  # -> geo; plug-in component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
vizwiref_12 = HBVisualizeWireframe(hb_objs=flatten(face_9.faces))  # -> geo; plug-in component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
preview_15 = CustomPreview(Geometry=vizwiref_12, Material=ColourSwatch(SwatchColor=RGB(0, 0, 0)))
preview_16 = CustomPreview(Geometry=vizwiref_11, Material=ColourSwatch(SwatchColor=RGB(0, 0, 0)))
brep_14 = Brep([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])
aperturesbyratio_6 = HBAperturesByRatio(
    hb_objs=flatten(face_10.faces),
    ratio=south_wwr,
    win_height=window_height_4,
    sill_height=sill_height_4,
    operable=Toggle(True))  # -> report, hb_objs; plug-in component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
aperturesbyratio_7 = HBAperturesByRatio(
    hb_objs=flatten(face_9.faces),
    ratio=west_wwr,
    win_height=window_height_5,
    sill_height=sill_height_5,
    operable=Toggle(True))  # -> report, hb_objs; plug-in component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
face_11 = HBFace(geo=brep_14, name="Kitchen ")  # -> report, faces; plug-in component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

applywindowconstr_6 = HBApplyWindowConstruction(hb_objs=flatten(aperturesbyratio_7.hb_objs), constr=windowconstr_2)  # -> hb_objs; plug-in component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
applywindowconstr_7 = HBApplyWindowConstruction(hb_objs=flatten(aperturesbyratio_6.hb_objs), constr=windowconstr)  # -> hb_objs; plug-in component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
applywindowmod_6 = HBApplyWindowModifier(hb_objs=flatten(applywindowconstr_6), mod=transmod_4)  # -> hb_objs; plug-in component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
applywindowmod_7 = HBApplyWindowModifier(hb_objs=flatten(applywindowconstr_7), mod=transmod)  # -> hb_objs; plug-in component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

room_4 = HBRoom(
    faces=flatten([face_11.faces, applywindowmod_6, applywindowmod_7]),
    name="Kitchen ",
    constr_set=constructionset,
    program=programtype_2,
    conditioned=Toggle(False))  # -> report, room; plug-in component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
vizwiref_13 = HBVisualizeWireframe(hb_objs=flatten(room_4.room))  # -> geo; plug-in component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
preview_17 = CustomPreview(Geometry=vizwiref_13, Material=ColourSwatch(SwatchColor=RGB(0, 0, 0)))

solveadj = HBSolveAdjacency(rooms=flatten([room.room, room_4.room]), air_boundary=Toggle(True), run=Toggle(True))  # -> report, adj_rooms; plug-in component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

brep_15 = Brep(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)
brep_16 = Brep(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)
face_12 = HBFace(geo=brep_15, name="North")  # -> report, faces; plug-in component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
face_13 = HBFace(geo=brep_16, name="West")  # -> report, faces; plug-in component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
vizwiref_14 = HBVisualizeWireframe(hb_objs=flatten(face_12.faces))  # -> geo; plug-in component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
vizwiref_15 = HBVisualizeWireframe(hb_objs=flatten(face_13.faces))  # -> geo; plug-in component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
preview_18 = CustomPreview(Geometry=vizwiref_14, Material=ColourSwatch(SwatchColor=RGB(0, 0, 0)))
preview_19 = CustomPreview(Geometry=vizwiref_15, Material=ColourSwatch(SwatchColor=RGB(0, 0, 0)))
brep_17 = Brep([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])
aperturesbyratio_8 = HBAperturesByRatio(
    hb_objs=flatten(face_13.faces),
    ratio=west_wwr,
    win_height=window_height_6,
    sill_height=sill_height_6,
    operable=Toggle(True))  # -> report, hb_objs; plug-in component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
aperturesbyratio_9 = HBAperturesByRatio(
    hb_objs=flatten(face_12.faces),
    ratio=north_wwr,
    win_height=window_height_7,
    sill_height=sill_height_7,
    operable=Toggle(True))  # -> report, hb_objs; plug-in component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
face_14 = HBFace(geo=brep_17, name="Bedroom_2 ")  # -> report, faces; plug-in component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

applywindowconstr_8 = HBApplyWindowConstruction(hb_objs=flatten(aperturesbyratio_8.hb_objs), constr=windowconstr_2)  # -> hb_objs; plug-in component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
applywindowconstr_9 = HBApplyWindowConstruction(hb_objs=flatten(aperturesbyratio_9.hb_objs), constr=windowconstr_4)  # -> hb_objs; plug-in component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
applywindowmod_8 = HBApplyWindowModifier(hb_objs=flatten(applywindowconstr_8), mod=transmod_4)  # -> hb_objs; plug-in component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
applywindowmod_9 = HBApplyWindowModifier(hb_objs=flatten(applywindowconstr_9), mod=transmod_2)  # -> hb_objs; plug-in component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

room_5 = HBRoom(
    faces=flatten([face_14.faces, applywindowmod_9, applywindowmod_8]),
    name="Bedroom_2 ",
    constr_set=constructionset,
    program=programtype,
    conditioned=Toggle(False))  # -> report, room; plug-in component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
vizwiref_16 = HBVisualizeWireframe(hb_objs=flatten(room_5.room))  # -> geo; plug-in component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
preview_20 = CustomPreview(Geometry=vizwiref_16, Material=ColourSwatch(SwatchColor=RGB(0, 0, 0)))

solveadj_2 = HBSolveAdjacency(rooms=flatten([room_3.room, room_5.room, room_2.room]), air_boundary=Toggle(False), run=Toggle(True))  # -> report, adj_rooms; plug-in component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
solveadj_3 = HBSolveAdjacency(rooms=flatten([solveadj_2.adj_rooms, solveadj.adj_rooms]), air_boundary=Toggle(False), run=Toggle(True))  # -> report, adj_rooms; plug-in component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
vizwiref_17 = HBVisualizeWireframe(hb_objs=flatten(solveadj_3.adj_rooms))  # -> geo; plug-in component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
decnstrobj = HBDeconstructObject(hb_obj=solveadj_3.adj_rooms)  # -> faces, apertures, doors, shades; plug-in component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
colorroomattr = HBColorRoomAttributes(rooms_model=flatten(solveadj_3.adj_rooms), attribute=roomattr)  # -> mesh, legend, wire_frame, values, colors, vis_set; plug-in component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
labelrooms = HBLabelRooms(rooms_model=flatten(solveadj_3.adj_rooms), attribute=roomattr, txt_height="1")  # -> label_text, base_pts, labels, wire_frame; plug-in component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
preview_21 = CustomPreview(Geometry=vizwiref_17, Material=ColourSwatch(SwatchColor=RGB(0, 0, 0)))
vizwiref_18 = HBVisualizeWireframe(hb_objs=flatten(solveadj_3.adj_rooms))  # -> geo; plug-in component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
aperturegroup = HBDynamicApertureGroup(apertures=decnstrobj.apertures, name="ventanas")  # -> group_aps; plug-in component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
preview_22 = CustomPreview(Geometry=vizwiref_18, Material=ColourSwatch(SwatchColor=RGB(0, 0, 0)))
windowopen = HBWindowOpening(
    rooms=flatten(solveadj_3.adj_rooms),
    vent_cntrl=ventcontrol,
    fract_area_oper="0.5",
    discharge_coeff="0.45",
    wind_cross_vent=Toggle(True))  # -> report, rooms; plug-in component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
applysetpointvals = HBApplySetpointValues(room_or_program=flatten(windowopen.rooms))  # -> report, mod_obj; plug-in component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
vizwiref_19 = HBVisualizeWireframe(hb_objs=flatten(applysetpointvals.mod_obj))  # -> geo; plug-in component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
lablefaces = HBLabelFaces(hb_objs=flatten(applysetpointvals.mod_obj), attribute=roomattr_2, sub_faces=Toggle(False))  # -> label_text, base_pts, labels, wire_frame; plug-in component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
preview_23 = CustomPreview(Geometry=vizwiref_19, Material=ColourSwatch(SwatchColor=RGB(0, 0, 0)))
model = HBModel(rooms=flatten(applysetpointvals.mod_obj), shades=flatten([shade.shades, shade_2.shades]), name="viviendasocialHND")  # -> report, model; plug-in component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
deconstructmodel = HBDeconstructModel(model=model.model)  # -> rooms, faces, apertures, doors, shades; plug-in component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
decnstrobj_2 = HBDeconstructObject(hb_obj=deconstructmodel.rooms)  # -> faces, apertures, doors, shades; plug-in component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
panel_61 = Panel(model.model)
lablefaces_2 = HBLabelFaces(hb_objs=flatten(model.model), attribute=faceattr_2, sub_faces=Toggle(True))  # -> label_text, base_pts, labels, wire_frame; plug-in component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
colorfaceattr = HBColorFaceAttributes(hb_objs=flatten(decnstrobj_2.apertures), attribute=faceradianceattr)  # -> mesh, legend, wire_frame, values, colors, vis_set; plug-in component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
roomsbyattr = HBRoomsByAttribute(rooms=flatten(model.model), attribute=faceenergyattr_3)  # -> values, rooms; plug-in component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
autogroup = HBAutomaticApertureGroup(model=model.model, run=Toggle(True))  # -> model; plug-in component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
colorroomattr_2 = HBColorRoomAttributes(rooms_model=flatten(model.model), attribute=roomattr_4, legend_par=legendpar)  # -> mesh, legend, wire_frame, values, colors, vis_set; plug-in component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
panel_62 = Panel(roomsbyattr.values)
panel_63 = Panel(roomsbyattr.rooms)
modeltoosm = HBModelToOSM(model=model.model, epw_file=downloadepw.epw_file, sim_par=simpar, write=Toggle(True), run=Toggle(False))  # -> report, jsons, osw, osm, idf, sql, zsz, rdd, html; plug-in component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
panel_64 = Panel(modeltoosm.jsons)
roomcomfortresult = HBReadRoomComfortResult(sql=modeltoosm.sql)  # -> oper_temp, air_temp, rad_temp, rel_humidity; plug-in component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

xdata = LBDeconstructData(data=roomcomfortresult.oper_temp)  # -> header, values; plug-in component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
panel_65 = Panel("G:\Mi unidad\Post-Doc DATAI\Investigación\Computational Design\_Occupancy\Sala_Comedor_Cocina.csv")
panel_66 = Panel("G:\Mi unidad\Post-Doc DATAI\Investigación\Computational Design\_Occupancy\Dorms_WC.csv")
bang = ExplodeTree(Data=xdata.values)  # -> Branch0, Branch1, Branch2, Branch3, Branch4
file_4 = ReadFile(File=panel_65, PerLineParse=True)
file_5 = ReadFile(File=panel_66, PerLineParse=True)
panel_67 = Panel("Bedroom_2")
panel_68 = Panel("Bedroom_1")
panel_69 = Panel("Kitchen")
flatten_4 = FlattenTree(Tree=bang.Branch0, Path="{0}")
panel_70 = Panel("WC")
flatten_5 = FlattenTree(Tree=bang.Branch2, Path="{0}")
flatten_6 = FlattenTree(Tree=bang.Branch1, Path="{0}")
panel_71 = Panel("Living_Dining")
flatten_7 = FlattenTree(Tree=bang.Branch3, Path="{0}")
flatten_8 = FlattenTree(Tree=bang.Branch4, Path="{0}")
flatten_9 = FlattenTree(Tree=file_4, Path="{0}")
flatten_10 = FlattenTree(Tree=file_5, Path="{0}")
panel_72 = Panel(flatten_5)
expression_6 = Expression(x=flatten_5, y=flatten_9, Expression="If((x*y)=0,0,x)")
expression_7 = Expression(x=flatten_7, y=flatten_9, Expression="If((x*y)=0,0,x)")
expression_8 = Expression(x=flatten_6, y=flatten_10, Expression="If((x*y)=0,0,x)")
expression_9 = Expression(x=flatten_8, y=flatten_10, Expression="If((x*y)=0,0,x)")
expression_10 = Expression(x=flatten_4, y=flatten_10, Expression="If((x*y)=0,0,x)")
expression_11 = Expression(x=expression_7, y=expression, Expression="If((x-y)<0,0,x-y)")
expression_12 = Expression(x=expression_6, y=expression, Expression="If((x-y)<0,0,x-y)")
expression_13 = Expression(x=expression_10, y=expression, Expression="If((x-y)<0,0,x-y)")
expression_14 = Expression(x=expression_8, y=expression, Expression="If((x-y)<0,0,x-y)")
expression_15 = Expression(x=expression_9, y=expression, Expression="If((x-y)<0,0,x-y)")
panel_73 = Panel(expression_12)
expression_16 = Expression(x=expression_12, Expression="If(x=0,0,1)")
expression_17 = Expression(x=expression_15, Expression="If(x=0,0,1)")
expression_18 = Expression(x=expression_13, Expression="If(x=0,0,1)")
expression_19 = Expression(x=expression_14, Expression="If(x=0,0,1)")
expression_20 = Expression(x=expression_11, Expression="If(x=0,0,1)")
eval = Evaluate(F=expression_14)
eval_2 = Evaluate(F=expression_13)
eval_3 = Evaluate(F=expression_12)
eval_4 = Evaluate(F=expression_11)
eval_5 = Evaluate(F=expression_15)
ma = MassAddition(Input=[eval_3, eval_2, eval, eval_4, eval_5])  # -> Result, PartialResults
python_13 = GhPythonScript()  # -> out, a
# ---------- python_13: Python ----------
__author__ = "jgamero"
__version__ = "2022.08.13"

import rhinoscriptsyntax as rs

Sala_Comedor_Cocina = 8*365
Dorms_WC = 10*365

a = (Sala_Comedor_Cocina*2) + (Dorms_WC*3) # Total number of occupied hours for all zones
print(a)
# ---------- end python_13 ----------
ma_2 = MassAddition(Input=[expression_18, expression_16, expression_19, expression_20, expression_17])  # -> Result, PartialResults
panel_74 = Panel(ma.Result)
division = Division(A=ma.Result, B=python_13.a)
panel_75 = Panel(python_13.a)
panel_76 = Panel(ma_2.Result)
division_2 = Division(A=ma_2.Result, B=panel_75)
panel_77 = Panel(division)
panel_78 = Panel(division_2)

panel_79 = Panel(xdata.header)
item_8 = ListItem(List=xdata.header, Index="4", Wrap=True)
item_9 = ListItem(List=xdata.header, Index="3", Wrap=True)
item_10 = ListItem(List=xdata.header, Index="2", Wrap=True)
item_11 = ListItem(List=xdata.header, Index="1", Wrap=True)
item_12 = ListItem(List=xdata.header, Index="0", Wrap=True)
flatten_11 = FlattenTree(Tree=item_8, Path="{0}")  # -> flatten(Tree)
flatten_12 = FlattenTree(Tree=item_9, Path="{0}")  # -> flatten(Tree)
flatten_13 = FlattenTree(Tree=item_10, Path="{0}")  # -> flatten(Tree)
flatten_14 = FlattenTree(Tree=item_11, Path="{0}")  # -> flatten(Tree)
flatten_15 = FlattenTree(Tree=item_12, Path="{0}")  # -> flatten(Tree)
python_14 = GhPythonScript(x=flatten_14)  # -> out, a
# ---------- python_14: Python ----------
__author__ = "jgamero"
__version__ = "2022.10.06"

import rhinoscriptsyntax as rs

dictx = x.to_dict()

metadt = dictx["metadata"]
for key, value in dictx["metadata"].items():
    # do something with value
    print(metadt["Zone"])


a = "Zone: " + metadt["Zone"]
print(a)
# ---------- end python_14 ----------
python_15 = GhPythonScript(x=flatten_15)  # -> out, a; same code as python_14
python_16 = GhPythonScript(x=flatten_13)  # -> out, a; same code as python_14
python_17 = GhPythonScript(x=flatten_12)  # -> out, a; same code as python_14
python_18 = GhPythonScript(x=flatten_11)  # -> out, a; same code as python_14
panel_80 = Panel([python_15.a, python_14.a, python_16.a, python_17.a, python_18.a])
panel_81 = Panel(expression_16)
panel_82 = Panel(panel_79)
merge_3 = Merge(Data1=python_17.a, Data2=panel_44)
merge_4 = Merge(Data1=python_18.a, Data2=panel_44)
merge_5 = Merge(Data1=python_15.a, Data2=panel_44)
merge_6 = Merge(Data1=python_14.a, Data2=panel_44)
merge_7 = Merge(Data1=python_16.a, Data2=panel_44)
panel_83 = Panel([merge_5, merge_6, merge_7, merge_3, merge_4])
constrheader = LBConstructHeader(data_type="Fraction", unit="%", metadata=merge_7)  # -> header; plug-in component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
constrheader_2 = LBConstructHeader(data_type="Fraction", unit="%", metadata=merge_6)  # -> header; plug-in component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
constrheader_3 = LBConstructHeader(data_type="Fraction", unit="%", metadata=merge_3)  # -> header; plug-in component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
constrheader_4 = LBConstructHeader(data_type="Fraction", unit="%", metadata=merge_5)  # -> header; plug-in component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
constrheader_5 = LBConstructHeader(data_type="Fraction", unit="%", metadata=merge_4)  # -> header; plug-in component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
panel_84 = Panel(constrheader_2)
panel_85 = Panel(constrheader_5)
panel_86 = Panel(constrheader)
panel_87 = Panel(constrheader_3)
panel_88 = Panel(constrheader_4)

sala_comedor_cocina = Panel("2920")
dorm_wc = Panel("3650")
ma_3 = MassAddition(Input=expression_16)  # -> Result, PartialResults
ma_4 = MassAddition(Input=expression_18)  # -> Result, PartialResults
ma_5 = MassAddition(Input=expression_19)  # -> Result, PartialResults
ma_6 = MassAddition(Input=expression_20)  # -> Result, PartialResults
ma_7 = MassAddition(Input=expression_17)  # -> Result, PartialResults
panel_89 = Panel(ma_4.Result)
panel_90 = Panel(ma_5.Result)
panel_91 = Panel(ma_6.Result)
panel_92 = Panel(ma_3.Result)
panel_93 = Panel(ma_7.Result)
division_3 = Division(A=panel_92, B=sala_comedor_cocina)
division_4 = Division(A=panel_89, B=dorm_wc)
division_5 = Division(A=panel_90, B=dorm_wc)
division_6 = Division(A=panel_91, B=sala_comedor_cocina)
division_7 = Division(A=panel_93, B=dorm_wc)
panel_94 = Panel(division_3)
panel_95 = Panel(division_4)
panel_96 = Panel(division_5)
panel_97 = Panel(division_6)
panel_98 = Panel(division_7)
ma_8 = MassAddition(Input=[panel_94, panel_95, panel_96, panel_97, panel_98])  # -> Result, PartialResults
panel_99 = Panel(ma_8.Result)
division_8 = Division(A=panel_99, B="5")
panel_100 = Panel(division_8)

roomattr_5 = HBRoomAttributes({"Display Name": "display_name", "Simulation Name (Identifier)": "identifier", "Multiplier": "multiplier", "Floor Area Excluded": "exclude_floor_area", "Story": "story", "Volume": "volume", "Gross Floor Area": "floor_area", "Exposed Area": "exposed_area", "Exterior Wall Area": "exterior_wall_area", "Exterior Aperture Area": "exterior_aperture_area", "Average Floor Elevation": "average_floor_height"}, selected="Gross Floor Area")
roomsbyattr_2 = HBRoomsByAttribute(rooms=flatten(room_2.room), attribute=roomattr_5)  # -> flatten(values), rooms; plug-in component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
roomsbyattr_3 = HBRoomsByAttribute(rooms=flatten(room_5.room), attribute=roomattr_5)  # -> flatten(values), rooms; plug-in component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
roomsbyattr_4 = HBRoomsByAttribute(rooms=flatten(room.room), attribute=roomattr_5)  # -> flatten(values), rooms; plug-in component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
roomsbyattr_5 = HBRoomsByAttribute(rooms=flatten(room_4.room), attribute=roomattr_5)  # -> flatten(values), rooms; plug-in component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
roomsbyattr_6 = HBRoomsByAttribute(rooms=flatten(room_3.room), attribute=roomattr_5)  # -> flatten(values), rooms; plug-in component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
panel_106 = Panel(roomsbyattr_5.values)
panel_107 = Panel(roomsbyattr_3.values)
panel_108 = Panel(roomsbyattr_6.values)
panel_109 = Panel(roomsbyattr_4.values)
panel_110 = Panel(roomsbyattr_2.values)
multiplication = Multiplication(A=panel_94, B=panel_106)  # -> flatten(Result)
multiplication_2 = Multiplication(A=panel_95, B=panel_108)  # -> flatten(Result)
multiplication_3 = Multiplication(A=panel_97, B=panel_109)  # -> flatten(Result)
multiplication_4 = Multiplication(A=panel_96, B=panel_107)  # -> flatten(Result)
multiplication_5 = Multiplication(A=panel_98, B=panel_110)  # -> flatten(Result)
panel_111 = Panel(multiplication_2)
panel_112 = Panel(multiplication)
panel_113 = Panel(multiplication_4)
panel_114 = Panel(multiplication_3)
panel_115 = Panel(multiplication_5)
ma_9 = MassAddition(Input=[panel_112, panel_111, panel_113, panel_114, panel_115])  # -> Result, PartialResults
ma_10 = MassAddition(Input=[panel_106, panel_108, panel_107, panel_109, panel_110])  # -> Result, PartialResults
panel_116 = Panel(ma_10.Result)
panel_117 = Panel(ma_9.Result)
division_9 = Division(A=ma_9.Result, B=ma_10.Result)
panel_118 = Panel(division_9)

python_19 = GhPythonScript(x=expression_13, y=ma_4.Result)  # -> out, a
# ---------- python_19: Python ----------
__author__ = "jgamero"
__version__ = "2022.10.06"

import rhinoscriptsyntax as rs

z = y/3650
a = ((x*0) + z) *100
# ---------- end python_19 ----------
python_20 = GhPythonScript(x=expression_12, y=ma_3.Result)  # -> out, a
# ---------- python_20: Python ----------
__author__ = "jgamero"
__version__ = "2022.10.06"

import rhinoscriptsyntax as rs

z = y/2920
a = ((x*0) + z) *100
# ---------- end python_20 ----------
python_21 = GhPythonScript(x=expression_14, y=ma_5.Result)  # -> out, a; same code as python_19
python_22 = GhPythonScript(x=expression_15, y=ma_7.PartialResults)  # -> out, a; same code as python_19
python_23 = GhPythonScript(x=expression_11, y=ma_6.Result)  # -> out, a; same code as python_20
data = LBConstructData(header=constrheader_3, values=python_23.a)  # -> data; plug-in component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
data_2 = LBConstructData(header=constrheader_2, values=python_21.a)  # -> data; plug-in component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
data_3 = LBConstructData(header=constrheader, values=python_20.a)  # -> data; plug-in component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
data_4 = LBConstructData(header=constrheader_4, values=python_19.a)  # -> data; plug-in component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
data_5 = LBConstructData(header=constrheader_5, values=python_22.a)  # -> data; plug-in component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
panel_119 = Panel(python_23.a)
merge_8 = Merge(Data1=data_4, Data2=data_2, Data3=data_3, Data4=data, Data5=data_5)  # -> flatten(Result)
colorrooms = HBColorRooms(data=flatten(merge_8), rooms_model=flatten(model.model), legend_par=legendpar_6)  # -> report, mesh, wire_frame, legend, title, rooms, colors, values; plug-in component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
preview_24 = CustomPreview(Geometry=vizquick, Material=colorrooms.colors)
panel_120 = Panel(merge_8)
colibri_out = ColibriOutputs(Data=flatten(panel_118))

gridrooms = HBSensorGridFromRooms(rooms=model.model, grid_size="0.2", dist_floor="0.75")  # -> grid, points, mesh; plug-in component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
wea = HBWeaFromEPW(epw_file=downloadepw.epw_file)  # -> wea; plug-in component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
assigngridsviews = HBAssignGridsAndViews(model=model.model, grids=flatten(gridrooms.grid))  # -> model; plug-in component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
panel_121 = Panel(gridrooms.mesh)
genes_2 = GenePool(Decimals=0, Maximum=1, Minimum=0, Value=[0, 0, 0, 0, 0, 0, 1, 1, 1, 1, 1, 1, 1, 1, 1, 1, 1, 1, 1, 0, 0, 0, 0, 0])
radpar = HBRadianceParameter(recipe_type="2", detail_level="2")  # -> rad_par; plug-in component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
getgridsviews = HBGetGridsAndViews(model=assigngridsviews)  # -> views, grids, points, meshes; plug-in component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
constantschedule_7 = HBConstantSchedule(values=genes_2)  # -> report, schedule, idf_text; plug-in component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
mjoin = MeshJoin(Meshes=getgridsviews.meshes)
panel_122 = Panel(getgridsviews.meshes)
Y = UnitY(Factor=1)
panel_123 = Panel(mjoin)
annualdaylight = HBAnnualDaylight(
    model=assigngridsviews,
    wea=wea,
    north=Y,
    schedule=constantschedule_7.schedule,
    radiance_par=radpar,
    run_settings="--workers 4",
    run=Toggle(False))  # -> report, results, DA, cDA, UDI, UDI_low, UDI_up; plug-in component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
flatten_16 = FlattenTree(Tree=annualdaylight.DA, Path="{0}")
colrange_7 = LBColorRange(index="9")  # -> colors; plug-in component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
col = Colour([ColourSwatch(SwatchColor=RGB(242, 236, 170)), ColourSwatch(SwatchColor=RGB(245, 227, 34)), ColourSwatch(SwatchColor=RGB(86, 189, 45)), ColourSwatch(SwatchColor=RGB(87, 127, 201)), ColourSwatch(SwatchColor=RGB(13, 32, 66))])
avr_3 = Average(Input=flatten_16)
rev_9 = ReverseList(List=col)
panel_124 = Panel(avr_3)
legendpar_7 = LBLegendParameters(min="50", max="100", colors=rev_9, continuous_leg="True", text_height="0.4")  # -> leg_par; plug-in component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

flatten_17 = FlattenTree(Tree=annualdaylight.UDI, Path="{0}")
flatten_18 = FlattenTree(Tree=annualdaylight.DA, Path="{0}")
flatten_19 = FlattenTree(Tree=annualdaylight.cDA, Path="{0}")
sda = HBSpatialDaylightAutonomy(DA=flatten_18, mesh=mjoin, target_time="80")  # -> report, sDA, pass_fail; plug-in component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
sda_2 = HBSpatialDaylightAutonomy(DA=flatten_18, mesh=mjoin, target_time="50")  # -> report, sDA, pass_fail; plug-in component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

col_2 = Colour([ColourSwatch(SwatchColor=RGB(0, 0, 0)), ColourSwatch(SwatchColor=RGB(251, 255, 0))])
legendpar_8 = LBLegendParameters(min="0", max="1", colors=col_2, text_height="0.4")  # -> leg_par; plug-in component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
heatmap = LBSpatialHeatmap(values=sda.pass_fail, mesh=mjoin, legend_par=legendpar_8)  # -> mesh, legend, title, colors, legend_par; plug-in component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

avr_4 = Average(Input=flatten_17)
avr_5 = Average(Input=flatten_19)
flatten_20 = FlattenTree(Tree=sda.sDA, Path="{0}")
flatten_21 = FlattenTree(Tree=sda_2.sDA, Path="{0}")
panel_125 = Panel(avr_5)
panel_126 = Panel(avr_4)
panel_127 = Panel(flatten_21)
panel_128 = Panel(flatten_20)

heatmap_2 = LBSpatialHeatmap(values=flatten_17, mesh=mjoin, legend_par=legendpar_7)  # -> mesh, legend, title, colors, legend_par; plug-in component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
colibri_out_2 = ColibriOutputs(
    DA=flatten(panel_124),
    cDA=flatten(panel_125),
    UDI=flatten(panel_126),
    sDA50=flatten(panel_127),
    sDA80=flatten(panel_128))

# ---- group: Simulation Results
panel_129 = Panel("G:\Mi unidad\Post-Doc DATAI\Investigación\Computational Design\_FractionalFactorialDesign\_results")
ca = ColibriAggregator(Folder=panel_129, Inputs=colibri_in_3.IP, Outputs=colibri_out_2, Write=Toggle(False), recordingMode=0)
